# Grasshopper definition repulsion_distribute.gh (Grasshopper 1.0.7)
# plug-ins: Kangaroo2 Components

pt = Point(Point(15, 15, 0))
pop2d = Populate2D(Region={Plane=PlaneXY(15, 15, 0), Size=Domain2(u=-15..15, v=-15..15)}, Count=13, Seed=13)
pt_2 = Point(flatten([pop2d, pt]))
ln = Line(StartPoint=pt, EndPoint=pop2d)
multiplication = Multiplication(A=pt_2, B=1000)
random = Random(Range=Domain(10, 50), Number=1, Seed=multiplication)  # -> flatten(Random)
pop2d_2 = Populate2D(Region={Plane=PlaneXY(15, 15, 0), Size=Domain2(u=-15..15, v=-15..15)}, Count=random, Seed=multiplication)
ln_2 = Line(StartPoint=graft(pt_2), EndPoint=pop2d_2)

# ---- group: nodes
pt_3 = Point(flatten([pt_2, pop2d_2, pt]))

# ---- group: edges
crv = Curve([ln_2, ln])

# ----
c_script = CSharpScript(
    pts=flatten(pt_3),
    range=Slider(3.75, range=0..15),
    strength="5",
    Reference="C:\Program Files\Rhino 7\Plug-ins\Grasshopper\Components\KangarooSolver.dll")  # -> out, A; inputs pts: list of Point3d, range: Double, strength: Double
# ---------- c_script: C# usings ----------
using System.IO;
using System.Linq;
using System.Data;
using System.Drawing;
using System.Reflection;
using System.Windows.Forms;
using System.Xml;
using System.Xml.Linq;
using System.Runtime.InteropServices;
using System.Threading.Tasks;
using Rhino.DocObjects;
using Rhino.Collections;
using GH_IO;
using GH_IO.Serialization;
using KangarooSolver;
using KangarooSolver.Goals;
# ---------- c_script: C# ----------
    A = new RangedAttraction(pts, range, 0.00001, strength);
# ---------- c_script: C# additional code ----------
  public class RangedAttraction : GoalObject
  {
    double range;
    double cutoff;
    double k;

    public RangedAttraction(List<Point3d> pts, double range, double cutoff, double strength)
    {
      PPos = pts.ToArray();
      Move = new Vector3d[PPos.Length];
      Weighting = new double[PPos.Length];
      this.range = range;
      this.cutoff = cutoff;
      this.k = strength;
    }

    public override void Calculate(List<KangarooSolver.Particle> p)
    {
      Point3d[] pts = this.GetCurrentPositions(p);
      var rTree = RTree.CreateFromPointArray(pts);
      var indices = new List<int>[pts.Length];
      var vecs = new List<Vector3d>[pts.Length];
      var multipliers = new List<double>[pts.Length];
     
      Parallel.For(0, pts.Length, i =>
        {
        Move[i] = Vector3d.Zero;
        Weighting[i] = 0;
        indices[i] = new List<int>();
        vecs[i] = new List<Vector3d>();
        multipliers[i] = new List<double>();
        rTree.Search(new Sphere(pts[i], range), (sender, args) =>
          {
          if (args.Id > i)
          {
            Vector3d separation = pts[args.Id] - pts[i];
            double dist = separation.Length;
            if(dist < range && dist > cutoff)
            {
              indices[i].Add(args.Id);
              vecs[i].Add(-0.5 * separation);              
              double r = range - dist;              
              multipliers[i].Add((1.0 / (dist * dist * dist)) * r);
            }
          }
          });
        });
   

      double[] multiplierSum = new double[pts.Length];

      for(int i = 0;i < pts.Length;i++)
      {
        for(int j = 0;j < indices[i].Count;j++)
        {
          if(vecs[i].Count > 0 && multipliers[i].Count > 0)
          {
            Vector3d v = vecs[i][j] * multipliers[i][j];
            Move[i] += v;
            Move[indices[i][j]] -= v;
            Weighting[i] += multipliers[i][j] * k;
            Weighting[indices[i][j]] += multipliers[i][j] * k;
            multiplierSum[i] += multipliers[i][j];
            multiplierSum[indices[i][j]] += multipliers[i][j];
          }
        }
      }

      for (int i = 0; i < pts.Length; i++)
      {
        if (multiplierSum.Length > 0 && multiplierSum[i] > 0) Move[i] *= 1.0 / multiplierSum[i];
      }
    }

  }
# ---------- end c_script ----------
length_line = LengthLine(Line=flatten(crv), Length="2", Strength="5")
solver = Solver(GoalObjects=[c_script.A, length_line], Reset=Button(), Threshold=1e-15, Tolerance=0.0001, On=Toggle(False))  # -> I, V, O
data = Data(solver.O)
dot = DotDisplay(Point=solver.V)
